# Grasshopper definition detekce_car.gh (Grasshopper 1.0.7)
# plug-ins: DetectLinesInPicture

# ---- group: Načtení obrázku - budov
get_load_image = GetLoadImage(Text="C:\Users\GeftGames\Desktop\katastr\budovy.png")

# ---- group: Ztmavnutí
gray_level = GrayLevel(Bitmap=get_load_image, GrayMin=0, GrayMax=Slider(23, range=0..255), ReverseOut="false")

# ---- group: Vytvoření masky / Invertování barev
invert_color = InvertColor(Bitmap=gray_level)

# ---- group: Vytvoření masky / Drobné rozmazání (obrázek má zubate okraje)
blur = Blur(Bitmap=invert_color, Size=Slider(2, range=2..10))

# ---- group: Vytvoření masky / Detekce hran dle matice
edge_detection = EdgeDetection(Bitmap=blur, Number=Slider(3, range=0..10))

# ---- group: Vytvoření masky / Zesvětlení obrázku
composity = Composity(Bitmap=edge_detection, Contrast=1, Brightness=0, Gama=Slider(4.3, range=0..10), ThresholdUp=255, ThresholdDown=0)

# ---- group: Ortofoto / Načtení obrázku ortofota
get_load_image_2 = GetLoadImage(Text="C:\Users\GeftGames\Desktop\katastr\ortofoto.png")

# ---- group: Velikost objektů
vector_xyz = VectorXYZ(XComponent=Slider(1, range=-1..1), YComponent=Slider(1, range=-1..1), ZComponent=0)  # -> Vector, Length

# ---- group: Umístění v projektu
construct_point = ConstructPoint(XCoordinate=0, YCoordinate=0, ZCoordinate=0)

# ---- group: Ortofoto / Nakreslit ortofoto
draw = Draw(Bitmap=get_load_image_2, Mode=Slider(3, range=3..50), Alpha=1, Position=construct_point, Vector=vector_xyz.Vector)

# ---- group: Detekce hran z obrázku
detect_lines = DetectLines(
    Bitmap=composity,
    Mode=Slider(0.957, range=0..1),
    Thickness=Slider(8, range=3..50),
    ConnectOthers=Slider(4.13, range=0..50),
    ClosingSelf=Slider(5.67, range=0..30),
    ConnectToBody=Slider(4.15, range=0..50),
    Simplify=Slider(7.543, range=0..100),
    IgnorePixelsPresearch=Slider(131, range=1..255),
    IgnorePixels=Slider(0, range=0..255),
    OnlyClosed=Toggle(True),
    Point=construct_point,
    Vector=vector_xyz.Vector)

# ---- group: Ortofoto / Vyrendrovat mesh / Mesh material
c_script = CSharpScript()  # -> out, A
# ---------- c_script: C# usings ----------
//using Rhino.Render;
# ---------- c_script: C# ----------
    Rhino.Render.RenderMaterial cxml = (Rhino.Render.RenderMaterial) Rhino.Render.RenderContent.Create(System.Guid.Parse("8B544B3E-D86F-4BCD-8494-FB660CF15E1C"), Rhino.Render.RenderContent.ShowContentChooserFlags.None, Rhino.RhinoDoc.ActiveDoc);
    //    A = cxml;

   // Rhino.RhinoDoc.ActiveDoc.RenderMaterials.Add(cxml);

    A = cxml.Xml;
# ---------- end c_script ----------

# ---- group: Ortofoto / Vyrendrovat mesh
custom_preview = CustomPreview(Geometry=draw, Material=c_script.A)

# ---- group: Sestavení geometrie budov
curve = Curve(detect_lines)

# ---- group: Sestavení geometrie budov / Výška budov
vector = Vector(Vector(0, 0, 100))

# ---- group: Sestavení geometrie budov / Střecha budov
boundary_surfaces = BoundarySurfaces(Edges=curve)
surface = Surface(boundary_surfaces)
move = Move(Geometry=surface, Motion=vector)  # -> Geometry, Transform

# ---- group: Sestavení geometrie budov / Fasáda budov
extrude = Extrude(Base=curve, Direction=vector)

# ---- group: Zobrazení / Barva budov
colour = Colour(RGB(219, 133, 99))

# ---- group: Zobrazení
brep = Brep(extrude)
custom_preview_2 = CustomPreview(Geometry=brep, Material=colour)
custom_preview_3 = CustomPreview(Geometry=move.Geometry, Material=colour)
